# Grasshopper definition dennis_sample.gh (Grasshopper 1.0.7)
# plug-ins: Urbano

toggle = BooleanToggle(True)
path = FilePath("C:\Users\Nikhil Saraf\Desktop\Urbano\samples\paris.osm")
importosm = ImportOpenStreetMapOSM(OsmFilePath=path, Natural="natural", Format=0, RunToggle=toggle)  # -> Points, Keys, Values
importosm_2 = ImportOpenStreetMapOSM(OsmFilePath=path, Building="building", Format=0, RunToggle=toggle)  # -> Points, Keys, Values
importosm_3 = ImportOpenStreetMapOSM(OsmFilePath=path, Street="street", Format=0, RunToggle=toggle)  # -> Points, Keys, Values
importosm_4 = ImportOpenStreetMapOSM(OsmFilePath=path, Amenity="amenity", Format=0, RunToggle=toggle)  # -> Points, Keys, Values
meta = Metadata(FieldNames=importosm_2.Keys, Values=importosm_2.Values)  # -> flatten(Metadata)
meta_2 = Metadata(FieldNames=importosm_4.Keys, Values=importosm_4.Values)  # -> flatten(Metadata)
meta_3 = Metadata(FieldNames=importosm_3.Keys, Values=importosm_3.Values)  # -> flatten(Metadata)
pline = PolyLine(Vertices=importosm_2.Points, Closed=False)  # -> flatten(Polyline)
pline_2 = PolyLine(Vertices=importosm_3.Points, Closed=False)  # -> flatten(Polyline)
pt = Point(flatten(importosm_4.Points))
amen = CreateAmenity(Location=pt, Metadata=meta_2)
street = CreateStreetSegment(Curve=pline_2, Metadata=meta_3, Key="name")
placeamen = PlaceAmenities(Amenities=amen, Buildings=pline, Tolerance=Slider(5, range=0..10))  # -> Buildings, UnappliedAmenities
toggle_2 = BooleanToggle(True)
network = Network(StreetSegments=street, BuildToggle=toggle_2)  # -> Network, Streets
bldg = CreateBuilding(Curve=placeamen.Buildings, Metadata=meta)
model = UrbanoModel(Buildings=bldg, StreetNetwork=network.Network, BuildToggle=toggle_2)  # -> Model, Activities
inbldg = InspectBuilding(UrbanoModel=model.Model, Building=bldg)  # -> Geometry, Metadata, Amenities
lookup = LookupMetadata(Metadata=inbldg.Metadata, Search="height")
crv = Curve(inbldg.Geometry)
Z = UnitZ(Factor=lookup)
extr = Extrude(Base=crv, Direction=Z)
