# Grasshopper definition features.gh (Grasshopper 1.0.7)
# plug-ins: Urbano

# Build a street network out of the
# street curves, (creates a routing and
# distance matrix, splits streets at intersections)
pipeline = GeometryPipeline(
    GroupByLayer=False,
    GroupByType=False,
    IncludeHidden=True,
    IncludeLocked=True,
    LayerFilter="streets",
    NameFilter="*",
    SublayerFiltering=True,
    TypeFilter=4)
build = BooleanToggle(True)
pipeline_2 = GeometryPipeline(
    GroupByLayer=False,
    GroupByType=False,
    IncludeHidden=True,
    IncludeLocked=True,
    LayerFilter="buildings",
    NameFilter="*",
    SublayerFiltering=True,
    TypeFilter=4)
network = Network(StreetSegments=pipeline, BuildToggle=build)  # -> Network, Streets

# ----
# Can do routing using just a street network
# (no urbano model), between arbitrary
# points and curves (mix and match)
crv = Curve(<curve referenced from the Rhino model>)
pt = Point(<point referenced from the Rhino model>)
router = Router(NetworkOrModel=network.Network, Origin=crv, Destination=pt)  # -> TripRoute, Path, Duration

# ----
# Build a model with buildings and the
# street network (population assigned to
# buildings, amenities tabled)
model = UrbanoModel(Buildings=pipeline_2, StreetNetwork=network.Network, BuildToggle=build)  # -> Model, Activities

# ----
# Get the metadata about a
# specific street (by curve), including
# the buildings that connect to it
crv_2 = Curve(<curve referenced from the Rhino model>)
insseg = InspectStreetSegment(UrbanoModel=model.Model, Street=crv_2)  # -> Geometry, Meta, AdjacentBuildings
lookup = LookupMetadata(Metadata=insseg.Meta, Search="id")

# ----
# Get population (or any other property)
# of every building (or a single building)
# Or find properties about
# specific amenities inside the buildings
pipeline_3 = GeometryPipeline(
    GroupByLayer=False,
    GroupByType=False,
    IncludeHidden=True,
    IncludeLocked=True,
    LayerFilter="buildings",
    NameFilter="*",
    SublayerFiltering=True,
    TypeFilter=4)
inbldg = InspectBuilding(UrbanoModel=model.Model, Building=pipeline_3)  # -> Geometry, Metadata, Amenities
inamen = InspectAmenity(Amenity=flatten(inbldg.Amenities))  # -> Name, Activities, Host
lookup_2 = LookupMetadata(Metadata=inbldg.Metadata, Search="population")

# ----
# Find all amenities of a certain activity
panel = Panel("bus_stop")
findamen = FindAmenities(UrbanoModel=model.Model, Activity=panel)
inamen_2 = InspectAmenity(Amenity=flatten(findamen))  # -> Name, Activities, Host

# ----
# Find the travel radius for a
# specific building and given time limit
# (15 minutes)
pipeline_4 = GeometryPipeline(
    GroupByLayer=False,
    GroupByType=False,
    IncludeHidden=True,
    IncludeLocked=True,
    LayerFilter="buildings",
    NameFilter="*",
    SublayerFiltering=True,
    TypeFilter=4)
crv_3 = Curve(<curve referenced from the Rhino model>)
time_limit = Slider(16, range=0..100)
router_2 = Router(NetworkOrModel=model.Model, Origin=crv_3, Destination=pipeline_4)  # -> TripRoute, Path, Duration
smaller = SmallerThan(FirstNumber=router_2.Duration, SecondNumber=time_limit)  # -> SmallerThan, OrEqualTo
dispatch = Dispatch(List=pipeline_4, DispatchPattern=smaller.OrEqualTo)  # -> ListA, ListB
crv_4 = Curve(dispatch.ListA)

# ----
# Find shortest route between
# any two buildings within the model
crv_5 = Curve(<curve referenced from the Rhino model>)
crv_6 = Curve(<curve referenced from the Rhino model>)
router_3 = Router(NetworkOrModel=model.Model, Origin=crv_5, Destination=crv_6)  # -> TripRoute, Path, Duration

# ----
# Number of people who used each street
# (Street hits) in these trips
# Number of people who visited each
# amenity (Amenity hits) in these trips
# Persona distribution-weighted
# average walk score
# Conduct WalkScore simulations for a
# specific building and population
# List of trips is
# branched by persona
# Get the different properties of the trips
# (people, amenity, path, score, cost, etc.)
# Personas represent the activities
# people need to do within the
# duration of the simulations
# Population distribution
# Ideally, should be run with all buildings input to WalkScore component to get
# an aggregrate walkscore for the entire model (can then weigh the score by the
# population of every building)
# Distribution of specific personas
# (by index) [Should add to 1]
# Then use other plugins (like Human) to visualize this data by showing colors
# and extrusions on the 2D geometry (curves for streets,
# footprints for buildings, locations of amenities)
panel_2 = Panel("""restaurant
bank
place_of_worship
bar""")
panel_3 = Panel("""cafe
cafe
school
library
cinema""")
persona = Persona(Activites=panel_2)
persona_2 = Persona(Activites=panel_3)
panel_4 = Panel("""0.75
0.25""")
crv_7 = Curve(<curve referenced from the Rhino model>)

merge = Merge(Data1=persona_2, Data2=persona)

population = Population(Personas=merge, Distribution=panel_4)
walkscore = WalkScore(UrbanoModel=model.Model, Building=crv_7, Population=population)  # -> WalkScore, Trips, Distribution
panel_5 = Panel(walkscore.WalkScore)
hits = StreetAmenityHits(UrbanoModel=model.Model, ActivityTrips=flatten(walkscore.Trips))  # -> StreetCurves, StreetHits, Amenities, AmenityHits
intrip = InspectTrip(Trip=flatten(walkscore.Trips))  # -> Origin, Destination, Path, Streets, Cost, Activity, Amenity, Score
